# Requirement set EScooter_Requirements (R2025b)

## 1 [F1.1] Das System muss ohne Nutzereingabe still stehen

## 2 [F1.2] Das System muss bei Nutzereingabe solange beschleunigen, bis [Event]

### 2.1 [F1.2.1] Das System muss bei Nutzereingabe solange beschleunigen, bis die Höchstgeschwindigkeit [20km/h] aus eigener Leistung erreicht wird

### 2.2 [F1.2.2] Das System muss bei Nutzereingabe solange beschleunigen, bis die Nutzereingabe stoppt

### 2.3 [F1.2.3] Das System muss bei Nutzereingabe solange beschleunigen, bis Leistungsgrenze überschritten wird

## 3 [F1.3] Das System muss kontinuierlich die Überschreitung der Höchstgeschwindigkeit [20km/h] und Leistungsgrenze prüfen und auf einen Maximalwert begrenzen

## 4 [F1.4] Das System muss bei Betätigung der Bremse mit mindestens [3,5 m/s^2] verzögern

## 5 [F1.5] Das System muss eine Steuerung der Fahrtrichtung bis [40°] ermöglichen

## 6 [F2.1] Das System muss elektrische Energie in einer Form speichern können

## 7 [F2.2] Das System muss über eine Schnittstelle für Haushaltssteckdosen mit Energie aufladbar sein

## 8 [F2.3] Das System muss die Maximalleistung an den Ladezustand des Speichers anpassen

## 9 [F2.4] Das System muss den Nutzer bei Überschreiten einer Schwelle im Ladezustand des Energiespeichern warnen

## 10 [F3.1] Das System muss dem Nutzer während dem Betrieb visuell Informationen zur Verfügung stellen

### 10.1 [F3.1.1] Aktuelle Geschwindigkeit

### 10.2 [F3.1.2] Ladezustand Energiespeicher

### 10.3 [F3.1.3] Aktuelle abgegebene Leistung

## 11 [F3.2] Das System muss eine Möglichkeit haben, ein Warnsignal für andere Verkehrsteilnehmer abzugeben

## 12 [F3.3] Das System muss eine Schnittstelle zu einer mobilen App bereitstellen. Übermittlung von [Daten]

### 12.1 [F3.3.1] Übermittlung vom Standort des Systems

### 12.2 [F3.3.1] Übermittlung Ladezustand Energiespeicher

## 13 [F4.1] Das System muss über einen Mechanismus verfügen, der das Wegfahren versperrt

## 14 [F4.2] Das System muss über einen Mechanismus verfügen, der das Wegfahren entsperrt

## 15 [NF1.1] Das System muss bei einem vollgeladenen Energiespeicher eine Strecke von [20km] unter maximaler Traglast auf einer ebenen Strecke zurücklegen können.

## 16 [NF1.2] Das System muss für eine maximale Traglast von [100kg] ausgelegt sein

## 17 [NF1.3] Das System muss innerhalb von [30min] von [10%] Ladezustand bis [80%] Ladezustand aufgeladen werden können bei Raumtemperatur (20 °C)

## 18 [NF1.4] Das System muss eine Leistung von mindestens [1000W] kurzzeitig abgeben können ohne sich zu beschädigen

## 19 [NF1.5] Das System muss dauerhaft eine Nenndauerleistung von maximal [500W] abgeben können

## 20 [NF2.1] Das System muss ein Gesamtgewicht von weniger als [20kg] aufweisen

## 21 [NF2.2] Das System muss über einen Mechanismus verfügen, der die physischen Dimensionen für die Lagerung reduziert.

## 22 [NF2.3] Das System muss über einen Mechanismus verfügen, der einer einzelnen Person ermöglicht das System ergonomisch tragen zu können

## 23 [NF3.1] Das System muss die Informationen (REQ F 3.1) bei verschiedenen Lichtverhältnissen deutlich lesbar präsentieren können

## 24 [NF3.2] Das System muss sich während der Fahrt vollständig bedienen lassen ohne, dass der Nutzer die standardmäßigen Haltestellen loslassen muss

## 25 [SAS1.1] Das System muss über eine Bremsmöglichkeit pro Rad verfügen

## 26 [SAS1.2] Das System muss redundante Leuchtmittel beinhalten

### 26.1 [SAS1.2.1] Frontleuchten für eine bessere Sicht bei Dunkelheit

### 26.2 [SAS1.2.2] Rückleuchten für die bessere Sichtbarkeit

## 27 [SAS1.3] Das System muss keine scharfen Kanten oder Grate aufweisen

## 28 [SAS1.4] Das System muss die Batterietemperatur kontinuierlich überwachen und sicherstellen dass kritische Temperatur [80°] nicht überschritten werden

### 28.1 [SAS1.4.1] Während der Fahrt

### 28.2 [SAS1.4.2] Während des Ladens

## 29 [SAS1.5] Das System muss einen sicheren Stand auf der Tragfläche ermöglichen

### 29.1 [SAS1.5.1] Durch eine Tragfläche mit einer Größe von mindestens [500 x 250mm]

### 29.2 [SAS1.5.2] Durch Tragfläche mit Reibungskoeffizient von mindestens [1,15]

## 30 [SAS1.6] Das System muss einen sicheren Griff an den Griffen ermöglichen

### 30.1 [SAS1.6.1] Durch ergonomisch geformte Griffe

### 30.2 [SAS1.6.2] Durch Griffe mit Reibungskoeffizient von mindestens [1]

## 31 [SAS1.7] Das System muss das Wegschleudern von Steinen auf andere Verkehrsteilnehmer verringern

## 32 [SAS1.8] Das System muss bei Systemstart seine einzelne Komponenten auf Funktion prüfen

## 33 [SAS1.9] Das System muss einen wirksamen Schutz gegen das direkte Berühren aller spannungsführenden Bauteile aufweisen

## 34 [SAS2.1] Das System muss vor Benutzung eine Authentifizierung des Nutzers erfordern, erst dann wird

### 34.1 [SAS2.1.1] Die Wegfahrsperre entsperrt

### 34.2 [SAS2.1.2] Der Antrieb entsperrt

## 35 [SAS2.2] Das System muss so gestaltet sein, dass keine digitalen Schnittstellen von außerhalb des Gehäuses zugänglich sind

## 36 [SAS2.3] Das System muss so gestaltet sein, dass der Zugang zum inneren des Gehäuses nur mit Spezialwerkzeug zerstörungsfrei zu öffnen ist

## 37 [SAS2.4] Das System muss bei Systemstart seine einzelne Komponenten auf Integrität prüfen