# Requirement set Regler_Requirements (R2025b)

## 1 [BAT_CTRL_1] Toleranz der Berechnung
Das System muss den SOC (State of Charge) der Fahrzeugbatterie mit einer Toleranz von +- 5% berechnen

## 2 [BAT_CTRL_2] Ausfallsicherheit
Das System muss bei Ausfall diesen selbstständig erkennen und an übergeordnete Systeme melden können.

## 3 [BAT_CTRL_3] Kalibrierungsmöglichkeit
Das System muss durch geschultes Personal innerhalb von 10 Minuten kalibrierbar sein

## 4 [BAT_CTRL_4] Kalibrierungsgenauigkeit
Das System muss seine Kalibrierungsgenauigkeit (Toleranz ±5%) für mindestens 24 Monate ohne Neukalibrierung beibehalten.

## 5 [BAT_CTRL_5] Reaktionszeit
Das System muss nach Power-On innerhalb von 500ms Ausgabewerte senden.

## 6 [BAT_CTRL_6] Temperatur-Derating bei Übertemperatur
Wenn die Zelltemperatur über 90 °C erreicht, muss der Nutzende innerhalb von maximal 1 Sekunde gewarnt werden.

## 7 [BAT_CTRL_7] Unterspannungsschutz
Wenn die Spannung unter 30 Volt fällt, soll der Nutzende eine Fehlermeldung erhalten.

## 8 [BAT_CTRL_8] Batteriewarnung
Wenn der SoC unter 20% fällt, soll der Nutzende über diesen Zustand informiert werden.

## 9 [BAT_CTRL_9] Fehlererkennung
Wenn die Zelltemperatur 90 Grad oder höher ist, die Spannung unter 30 Volt fällt und/oder der SoC unter 20%, muss das System dies dem Nutzenden melden können.