% Simulink data dictionary EScooter_Interfaces.sldd

IF_Brake_Digital = Simulink.Bus()  % [Timing: 10 ms (100 Hz)]
  % Digitales Signal des Bremshebels (1 = gezogen). Löst Motorabschaltung und Rekuperation aus.
  Switch_State: boolean, Min=0, Max=1  % Digitaler Zustand des Bremshebels. 0 = unbetätigt, 1 = betätigt (zieht Sicherheitsfunktion: Motor-Cutoff und Rekuperation).

IF_Energy_DC = Simulink.Bus()  % [Timing: Kontinuierlich]
  % Gleichspannung (DC) vom Akku zur Leistungselektronik. 48V Nennspannung des Systems.
  Voltage_DC: double, Min=39, Max=54.6, Unit="V"  % Positives Potenzial (DC+) der Hochspannungsleitung.
  Current_DC: double, Min=0, Max=15, Unit="A"  % Fließender Gleichstrom im Systemkreis.
  GND: double, Min=0, Max=0, Unit="V"  % Leistungs-Masse / Rückleiter (DC-) zum Batterie-Minuspol.

IF_Display_Digital = Simulink.Bus()  % [Timing: 100 ms (10 Hz)]
  % Datenfluss von der ECU zum Lenker-Display (HMI) für Echtzeit-Fahrinfos.
  Display_Speed: double, Min=0, Unit="km/h"  % Aktuelle Fahrtgeschwindigkeit zur Anzeige am Lenker-Display.
  Display_SOC: double, Min=0, Max=100, Unit="%"  % Lokale Anzeige des Batterieladezustands am Lenker.
  Display_Power: double, Min=0, Unit="W"  % Aktuell abgegebene Motorleistung zur Anzeige für den Fahrer.

IF_Energy_AC = Simulink.Bus()  % [Timing: Kontinuierlich]
  % 3-Phasen-Wechselspannungs-Energiefluss (AC) vom Inverter zum BLDC-Nabenmotor.
  Voltage_Phases: double[3], Min=-48, Max=48, Unit="V"  % 3-Phasen-Wechselspannung (AC) vom Inverter zum bürstenlosen Motor (BLDC) zur Erzeugung des Drehfeldes.
  Current_Phases: double[3], Min=-15, Max=15, Unit="A"  % 3-Phasen-Wechselstrom zur Motorsteuerung. Schwingt zwischen positiven und negativen Werten.

IF_Cloud_Telemetry = Simulink.Bus()  % [Timing: 1000 ms (1 Hz)]
  % Bidirektionaler Datenaustausch via IoT-Modul zur Cloud/Smartphone-App. Überträgt Possition, Status, Wartungsdaten und Sperrbefehle.
  State_Locked: boolean, Min=0, Max=1  % Befehl der App/Cloud zur Wegfahrsperre. 0 = System freigegeben, 1 = Roller gesperrt (Motor blockiert).
  Odometer_Total: double, Min=0, Unit="km"  % Kumulierte Gesamtdistanz des Scooters in Kilometern. Dient der Flottenverwaltung und Berechnung von Wartungsintervallen.
  Error_Code: int8, Min=0, Max=127  % Diagnose-Code der ECU für Fernwartung. 0 = System OK, >0 = spezifische Fehlercodes (z.B. Übertemperatur, Kabelbruch).
  Heartbeat: boolean, Min=0, Max=1  % Keep-Alive-Signal (Toggle 0/1 jede Sekunde). Ausbleiben signalisiert der Cloud einen kritischen Verbindungsabbruch oder Manipulation.
  GPS_Latitude: double, Min=-90, Max=90, Unit="deg"  % Breitengrad des aktuellen Scooter-Standorts (für App & Flottenmanagement).
  GPS_Longitude: double, Min=-180, Max=180, Unit="deg"  % Längengrad des aktuellen Scooter-Standorts.
  Status_SOC: double, Min=0, Max=100, Unit="%"  % Aktueller Ladezustand der Batterie (State of Charge) zur Übermittlung an die Cloud.

IF_Mechanic = Simulink.Bus()  % [Timing: Kontinuierlich]
  % Mechanische Energieübertragung vom Elektromotor auf das Hinterrad und die Straße.
  Torque: double, Min=-30, Max=30, Unit="N*m"  % Mechanisches Drehmoment an der Hinterradachse. Negativwerte repräsentieren Bremsmoment (Rekuperation).
  Rotational_Speed: double, Min=-60, Max=180, Unit="rad/s"  % Winkelgeschwindigkeit des Hinterrads. 180 rad/s entspricht 70 km/h, bei einem standard Rad von 215 mm durchmesser.

IF_Throttle_Analog = Simulink.Bus()  % [Timing: 10 ms (100 Hz)]
  % Analoge Spannungsversorgung und Signalrückführung des Hall-Effekt-Gasgriffs. Gültiger Signalbereich: 0.8V - 4.2V.
  VCC_5V: double, Min=4.75, Max=5.25, Unit="V"  % Konstante 5V Versorgungsspannung für den Hall-Sensor, bereitgestellt durch die ECU.
  GND: double, Min=0, Max=0, Unit="V"  % Elektrischer Massebezugspunkt (0V) für den Sensor.
  Signal_Voltage: double, Min=0, Max=5, Unit="V"  % Analoge Rückführspannung des Hall-Sensors. 0.8V = Nullstellung, 4.2V = Vollgas. Werte <0.5V oder >4.5V lösen Hardwarefehler aus.